vi "Function.gvi"   [LabVIEW Platform Developer Preview 0.1.0]
panel controls:
  "Low": bool
  "High": bool
panel indicators:
  "Sounds Data": f64[]
  "String": string
uses:
  Component::Read Tag Waveform.gvi
  Component::Update Tag.gvi
diagram:
  while (after "modulation") {
    Wait(time to wait=1000)
    call "Read Tag Waveform.gvi"(Server="skyline.southcentralus.cloudapp.azure.com", Tag="waveform") -> (values=w1)
    $"Sounds Data" <- w1
    stop if FALSE
  }
  while {
    Wait(time to wait=50)
    case ($Low) {
      frame False, Default { }
      frame True {
        Wait(time to wait=500)
        $String <- "Vote Recieved!"
        call "Update Tag.gvi"(Server="skyline.southcentralus.cloudapp.azure.com", Tag="modulation", Tag Value=0)
      }
    }
    $String <- ""
    case ($High) {
      frame False, Default { }
      frame True {
        Wait(time to wait=500)
        $String <- "Vote Recieved!"
        call "Update Tag.gvi"(Server="skyline.southcentralus.cloudapp.azure.com", Tag="modulation", Tag Value=2)
      }
    }
    stop if FALSE
  }
